# Grasshopper definition network_gen.gh (Grasshopper 1.0.7)
# plug-ins: Human

move = Move(Motion="{0,10,0}")  # -> Geometry, Transform

point = Point([Point(-9.820620565, 41.4672948, 8.020556886), Point(-9.820620565, 40.21729459, 8.020556886), Point(-9.820620565, 38.88396126, 8.020556886), Point(-9.820620565, 37.61312792, 8.020556886), Point(-9.820620565, 36.34229459, 8.020556886), Point(-9.820620565, 35.00896126, 8.020556886)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])
curve = Curve([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])
curve_2 = Curve([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])
curve_3 = Curve([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])
curve_4 = Curve([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])
curve_5 = Curve([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])
curve_6 = Curve([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])
curve_7 = Curve([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])
curve_8 = Curve(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)

curve_9 = Curve([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])  # disabled
curve_10 = Curve(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)  # disabled
curve_11 = Curve([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])
curve_12 = Curve(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)
curve_13 = Curve([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])
curve_14 = Curve([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])
curve_15 = Curve([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])
curve_16 = Curve([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])
merge = Merge(
    Data1=curve_16,
    Data2=curve_13,
    Data3=curve_11,
    Data4=curve_12,
    Data5=curve_14,
    Data6=curve_15,
    Data7=curve_9,
    Data8=curve_10)

point_2 = Point([Point(-9.820620565, 51.4672948, 8.020556886), Point(-9.820620565, 50.21729459, 8.020556886), Point(-9.820620565, 48.88396126, 8.020556886), Point(-9.820620565, 47.61312792, 8.020556886), Point(-9.820620565, 46.34229459, 8.020556886), Point(-9.820620565, 45.00896126, 8.020556886)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])
curve_middle = CurveMiddle(Curve=merge)
ghpython_script = GhPythonScript(points=point)  # -> out, network; inputs points: list of Point3d
# ---------- ghpython_script: Python ----------
import rhinoscriptsyntax as rs

from compas.datastructures import Network

# 1. instantiate an empty network
network = Network()

for point in points:
    #print(point)
    network.add_node(x=point[0], y=point[1], z=point[2])

network.summary()
print(network)
# ---------- end ghpython_script ----------
ghpython_script_2 = GhPythonScript(points=curve_middle)  # -> out, network; inputs points: list of Point3d; same code as ghpython_script
panel = Panel(ghpython_script.out)
ghpython_script_3 = GhPythonScript(
    network=ghpython_script.network,
    end_rafters=curve,
    mid_rafters=curve_2,
    joists=curve_3,
    ridges=curve_4,
    plates=curve_5,
    posts=curve_6)  # -> out, summary, network; inputs end_rafters: list of Curve, mid_rafters: list of Curve, joists: list of Curve, ridges: list of Curve, plates: list of Curve, posts: list of Curve
# ---------- ghpython_script_3: Python ----------
import rhinoscriptsyntax as rs

from compas.datastructures import Network

from compas.utilities import geometric_key
from compas.geometry import KDTree


def add_edges_to_network(lines,network,name):
    
    for line in lines:
        start = rs.CurveStartPoint(line)
        end = rs.CurveEndPoint(line)
        
        n_start = gkey_node[geometric_key(start)]
        n_end = gkey_node[geometric_key(end)]
        network.add_edge(n_start,n_end, type=name)
        #print(n_start,n_end)
        

# ==============================================================================
# Main
# ==============================================================================

network = network.copy()
node_xyz = {node: network.node_coordinates(node) for node in network.nodes()}
gkey_node = {geometric_key(xyz): node for node, xyz in node_xyz.items()}
search_tree = KDTree(node_xyz.values())

add_edges_to_network(end_rafters,network,"end_rafter")
add_edges_to_network(mid_rafters,network,"mid_rafter")
add_edges_to_network(joists,network,"joist")
add_edges_to_network(ridges,network,"ridge")
add_edges_to_network(plates,network,"plate")
add_edges_to_network(posts,network,"post")

#print(network)
network.summary()
for node in network.nodes():
    print(network.is_leaf(node))
# ---------- end ghpython_script_3 ----------
ghpython_script_4 = GhPythonScript(
    network=ghpython_script_2.network,
    all_lines=merge,
    end_rafters=curve_16,
    mid_rafters=curve_13,
    joists=curve_11,
    ridges=curve_12,
    plates=curve_14,
    posts=curve_15,
    studs=curve_9,
    bot_plates=curve_10)  # -> out, summary, network; inputs all_lines: list of Curve, end_rafters: list of Curve, mid_rafters: list of Curve, joists: list of Curve, ridges: list of Curve, plates: list of Curve, posts: list of Curve, studs: list of Curve, bot_plates: list of Curve
# ---------- ghpython_script_4: Python ----------
import rhinoscriptsyntax as rs
import Rhino as rc

from compas.datastructures import Network

from compas.utilities import geometric_key
from compas.geometry import KDTree


def add_edges_to_network(lines,network,name):
    
    for line in lines:
        start = rs.CurveStartPoint(line)
        end = rs.CurveEndPoint(line)
        
        mid = (start+end)/2
        print(mid)
        print(start,end)
        
        n_start = gkey_node[geometric_key(start)]
        n_end = gkey_node[geometric_key(end)]
        network.add_edge(n_start,n_end, type=name)
        #print(n_start,n_end)
        
        
def find_mid(crv):
    start = crv.PointAtStart
    end = crv.PointAtEnd
    mid = (start + end)/2
    return mid
    
        
def is_intersect_single(crvA,crvB):
    tol = 0.001
    ovlTol = 0.00
    ccx = rc.Geometry.Intersect.Intersection.CurveCurve(crvA, crvB, tol, ovlTol)
    
    if ccx:
        return True
    else:
        return False
        
def is_there_edge(n1,n2,network):
    
    a = network.has_edge(n1,n2)
    b = network.has_edge(n2,n1)
    
    if a or b:
        return True
    else:
        return False
    

def add_edges_to_network2(crvs,network,name):
    
    for crvA in crvs:
        for crvB in all_lines:
            
            if is_intersect_single(crvA,crvB):
                #print("intersection")
                midA = find_mid(crvA)
                midB = find_mid(crvB)
                
                if midA != midB:
                    #print("not same ele")
                    n_start = gkey_node[geometric_key(midA)]
                    n_end = gkey_node[geometric_key(midB)]
                    
                    if not is_there_edge(n_start,n_end,network):
                        network.add_edge(n_start,n_end, type=name)
                        #print(n_start,n_end)
            

# ==============================================================================
# Main
# ==============================================================================

network = network.copy()
node_xyz = {node: network.node_coordinates(node) for node in network.nodes()}
gkey_node = {geometric_key(xyz): node for node, xyz in node_xyz.items()}
search_tree = KDTree(node_xyz.values())

add_edges_to_network2(end_rafters,network,"end_rafter")
add_edges_to_network2(mid_rafters,network,"mid_rafter")
add_edges_to_network2(joists,network,"joist")
add_edges_to_network2(ridges,network,"ridge")
add_edges_to_network2(plates,network,"plate")
add_edges_to_network2(posts,network,"post")
add_edges_to_network2(studs,network,"stud")
add_edges_to_network2(bot_plates,network,"bot_plate")

#print(network)
network.summary()
for node in network.nodes():
    print(network.is_leaf(node))
# ---------- end ghpython_script_4 ----------
ghpython_script_5 = GhPythonScript(network=ghpython_script_4.network, i=Slider(100, range=0..100), delete=Toggle(True))  # -> out, network_copy
# ---------- ghpython_script_5: Python ----------
import rhinoscriptsyntax as rs

from compas.datastructures import Network

network_copy = network.copy()

network_copy.summary()

if delete:
    network_copy.delete_node(i)

network_copy.summary()
# ---------- end ghpython_script_5 ----------
panel_2 = Panel(ghpython_script_4.out)
panel_3 = Panel(ghpython_script_5.out)
panel_4 = Panel(ghpython_script_3.out)

data = Data(ghpython_script_5.network_copy)
data_2 = Data(ghpython_script_4.network)
data_3 = Data(ghpython_script_5.network_copy)
python = GhPythonScript(network=data_2)  # -> out, anchor_points
# ---------- python: Python ----------
import rhinoscriptsyntax as rs

anchor_points = []

for node in network.nodes():
    
    if network.node_attribute(node, "type") == "is_anchor":
        xyz = network.node_coordinates(node)
        point = rs.AddPoint(*xyz)
        anchor_points.append(point)
# ---------- end python ----------
python_2 = GhPythonScript(network=data)  # -> out, spring_points
# ---------- python_2: Python ----------
import rhinoscriptsyntax as rs

spring_points = []

for node in network.nodes():
    #is_spring = network.node_attribute(key=node, name="is_spring")
    #if is_spring:
    xyz = network.node_coordinates(node)
    point = rs.AddPoint(*xyz)
    spring_points.append(point)
# ---------- end python_2 ----------
python_3 = GhPythonScript(network=data_3)  # -> out, rafter_edges, rest_edges, ridge_edges
# ---------- python_3: Python ----------
from compas_ghpython.artists import NetworkArtist


bricks = []
glue = []

for edge in network.edges():
    edge_type = network.edge_attribute(key=edge, name="type")
    if edge_type == "brick":
        print("here")
        bricks.append(edge)
    elif edge_type == "glue":
        glue.append(edge)
        

bricks = []
glue = []

rafters = []
ridge = []
rest = []


for edge in network.edges():
    edge_type = network.edge_attribute(key=edge, name="type")
    if edge_type == "mid_rafter":
        rafters.append(edge)
    elif edge_type == "end_rafter":
        rafters.append(edge)
    elif edge_type == "ridge":
        ridge.append(edge)
    else:
        rest.append(edge)



artist = NetworkArtist(network)
#brick_edges = artist.draw_edges(keys=bricks)
rafter_edges = artist.draw_edges(rafters)
ridge_edges = artist.draw_edges(ridge)
rest_edges = artist.draw_edges(rest)
# ---------- end python_3 ----------
pt = Point(python_2.spring_points)
crv = Curve(python_3.rest_edges)
crv_2 = Curve(python_3.rafter_edges)
pt_2 = Point(python.anchor_points)
pt_3 = Point(pt)
pt_4 = Point(pt_2)
crv_3 = Curve(crv_2)
crv_4 = Curve(crv)
msphere = MeshSphere(Base=pt_3, Radius="0.1", UCount=10, VCount=20)
msphere_2 = MeshSphere(Base=pt_4, Radius="20", UCount=10, VCount=20)
entwine = Entwine(
    Branch00=ColourSwatch(SwatchColor=RGB(0, 255, 119)),
    Branch01=ColourSwatch(SwatchColor=RGB(202, 87, 255)),
    Branch02=ColourSwatch(SwatchColor=RGB(255, 0, 0)),
    FlattenInputs=True)
entwine_2 = Entwine(Branch00="5", Branch01="5", Branch02="5", FlattenInputs=True)
preview = CustomPreview(Geometry=msphere, Material=ColourSwatch(SwatchColor=RGB(250, 140, 37)))
preview_2 = CustomPreview(Geometry=msphere_2, Material=ColourSwatch(SwatchColor=RGB(37, 207, 250)))

crv_5 = Curve(python_3.ridge_edges)
crv_6 = Curve(crv_5)

entwine_3 = Entwine(Branch00=crv_3, Branch01=crv_4, Branch02=crv_6, FlattenInputs=True)
previewlw = CustomPreviewLineweights(Geometry=entwine_3, Shader=entwine, Thickness=entwine_2, Absolute=False)

preview_3 = CustomPreview(Geometry=entwine_3, Material=entwine)
