# Grasshopper definition zerowaste_FEM.gh (Grasshopper 1.0.7)
# plug-ins: karambaGH

# ----
# disassembly step
number_slider = Slider(0, range=-1..12)

# ----
# density is a but consverative, could probably go down to 5 kn/m^3
material_selection_karamba3d = MaterialSelectionKaramba3D(menu=[dropdown(4), dropdown(1)])
width = Panel("5")
width_2 = Panel("10")
height = Panel("10")
height_2 = Panel("10")
width_3 = Panel("10")
height_3 = Panel("15")
width_4 = Panel("5")
height_4 = Panel("15")
cross_section_karamba3d = CrossSectionKaramba3D(
    FamilyNameOfCrossSection="DefaultCroSec",
    NameOfCrossSection="2x4",
    Material=material_selection_karamba3d,
    Height_cm=height,
    UpperFlangeWidth_cm=width,
    LowerFlangeWidth_cm=width,
    mode="Trapezoid")
cross_section_karamba3d_2 = CrossSectionKaramba3D(
    FamilyNameOfCrossSection="DefaultCroSec",
    NameOfCrossSection="4x4",
    Material=material_selection_karamba3d,
    Height_cm=height_2,
    UpperFlangeWidth_cm=width_2,
    LowerFlangeWidth_cm=width_2,
    mode="Trapezoid")
cross_section_karamba3d_3 = CrossSectionKaramba3D(
    FamilyNameOfCrossSection="DefaultCroSec",
    NameOfCrossSection="4x6",
    Material=material_selection_karamba3d,
    Height_cm=height_4,
    UpperFlangeWidth_cm=width_3,
    LowerFlangeWidth_cm=width_3,
    mode="Trapezoid")
cross_section_karamba3d_4 = CrossSectionKaramba3D(
    FamilyNameOfCrossSection="DefaultCroSec",
    NameOfCrossSection="2x6",
    Material=material_selection_karamba3d,
    Height_cm=height_3,
    UpperFlangeWidth_cm=width_4,
    LowerFlangeWidth_cm=width_4,
    mode="Trapezoid")
cross_section_karamba3d_5 = CrossSectionKaramba3D(cross_section_karamba3d)
cross_section_karamba3d_6 = CrossSectionKaramba3D(cross_section_karamba3d_2)
cross_section_karamba3d_7 = CrossSectionKaramba3D(cross_section_karamba3d_3)
cross_section_karamba3d_8 = CrossSectionKaramba3D(cross_section_karamba3d_4)

# ----
# joints
panel = Panel("""rafter_main_1
rafter_main_2""")
panel_2 = Panel("""joist
header_connect1
header_connect2
post""")
beam_joints_karamba3d = BeamJointsKaramba3D(
    ElementIdentifiers=panel,
    CtKNMAtStartingNode=Vector(0, 0, 0),
    CrKNmRadAtStartingNode=Vector(0, 0, 0),
    CtKNMAtEndNode=Vector(0, 0, 0),
    CrKNmRadAtEndNode=Vector(0, 0, 0),
    menu=[buttons(off, off, off, off, off, off), buttons(off, off, off, on, off, on)])
beam_joints_karamba3d_2 = BeamJointsKaramba3D(
    ElementIdentifiers=panel_2,
    CtKNMAtStartingNode=Vector(0, 0, 0),
    CrKNmRadAtStartingNode=Vector(0, 0, 0),
    CtKNMAtEndNode=Vector(0, 0, 0),
    CrKNmRadAtEndNode=Vector(0, 0, 0),
    menu=[buttons(off, off, off, off, on, on), buttons(off, off, off, on, on, on)])
joint_karamba3d = JointKaramba3D(beam_joints_karamba3d)
joint_karamba3d_2 = JointKaramba3D(beam_joints_karamba3d_2)

# ----
# loads
# supports
point = Point([<point referenced from the Rhino model> x7])
point_2 = Point(point)
loads_karamba3d = LoadsKaramba3D(ForceVector="-10,0,0", Local=False, PosInd=point_2, LCase="1", mode="Point")
loads_karamba3d_2 = LoadsKaramba3D(Vector=Vector(0, 0, -1), LCase=0, mode="Gravity")
load_karamba3d = LoadKaramba3D(loads_karamba3d)
load_karamba3d_2 = LoadKaramba3D(loads_karamba3d_2)

curve = Curve([<curve referenced from the Rhino model> x9])
curve_2 = Curve([<curve referenced from the Rhino model> x9])

# ----
# top plate
curve_3 = Curve([<curve referenced from the Rhino model> x8])
curve_4 = Curve([<curve referenced from the Rhino model> x16])
curve_5 = Curve([<curve referenced from the Rhino model> x18])
curve_6 = Curve([<curve referenced from the Rhino model> x6])
entwine = Entwine(Branch00=curve_3, Branch01=curve_4, Branch02=curve_5, Branch03=curve_6, FlattenInputs=True)
panel_3 = Panel("""top_plate1
top_plate2
top_plate3
top_plate4""")
cross_section_karamba3d_9 = CrossSectionKaramba3D(cross_section_karamba3d_6)
line_to_beam_karamba3d = LineToBeamKaramba3D(
    Line=entwine,
    Identifier=graft(panel_3),
    CrossSection=cross_section_karamba3d_9,
    New=True,
    Remove=True,
    LimitDistance_m=0.005,
    Bending=Toggle(True))  # -> Element, Points, Info
element_karamba3d = ElementKaramba3D(flatten(line_to_beam_karamba3d.Element))

# ----
# rafters
curve_7 = Curve([<curve referenced from the Rhino model> x7])
curve_8 = Curve([<curve referenced from the Rhino model> x7])
curve_9 = Curve([<curve referenced from the Rhino model> x7])
curve_10 = Curve([<curve referenced from the Rhino model> x7])
entwine_2 = Entwine(Branch00=curve_7, Branch01=curve_8, Branch02=curve_9, Branch03=curve_10, FlattenInputs=True)
panel_4 = Panel("""rafter_tail_1
rafter_main_1
rafter_tail_2
rafter_main_2""")
cross_section_karamba3d_10 = CrossSectionKaramba3D(cross_section_karamba3d_8)
line_to_beam_karamba3d_2 = LineToBeamKaramba3D(
    Line=entwine_2,
    Identifier=graft(panel_4),
    CrossSection=cross_section_karamba3d_10,
    New=True,
    Remove=True,
    LimitDistance_m=0.005,
    Bending=Toggle(True))  # -> Element, Points, Info
element_karamba3d_2 = ElementKaramba3D(flatten(line_to_beam_karamba3d_2.Element))

# ----
# ridge
curve_11 = Curve([<curve referenced from the Rhino model> x6])
entwine_3 = Entwine(Branch00=curve_11, FlattenInputs=True)
cross_section_karamba3d_11 = CrossSectionKaramba3D(cross_section_karamba3d_8)
line_to_beam_karamba3d_3 = LineToBeamKaramba3D(
    Line=entwine_3,
    Identifier="ridge",
    CrossSection=cross_section_karamba3d_11,
    New=True,
    Remove=True,
    LimitDistance_m=0.005,
    Bending=Toggle(True))  # -> Element, Points, Info
element_karamba3d_3 = ElementKaramba3D(flatten(line_to_beam_karamba3d_3.Element))

# ----
# joists
curve_12 = Curve([<curve referenced from the Rhino model> x5])
entwine_4 = Entwine(Branch00=curve_12, FlattenInputs=True)
cross_section_karamba3d_12 = CrossSectionKaramba3D(cross_section_karamba3d_5)
line_to_beam_karamba3d_4 = LineToBeamKaramba3D(
    Line=entwine_4,
    Identifier="joist",
    CrossSection=cross_section_karamba3d_12,
    New=True,
    Remove=True,
    LimitDistance_m=0.005,
    Bending=Toggle(True))  # -> Element, Points, Info
element_karamba3d_4 = ElementKaramba3D(flatten(line_to_beam_karamba3d_4.Element))

# ----
# posts and connectors
curve_13 = Curve([<curve referenced from the Rhino model> x2])
curve_14 = Curve([<curve referenced from the Rhino model> x9])
curve_15 = Curve([<curve referenced from the Rhino model> x9])
entwine_5 = Entwine(Branch00=curve_13, Branch01=curve_14, Branch02=curve_15, FlattenInputs=True)
panel_5 = Panel("""post
header_connect1
header_connect2""")
cross_section_karamba3d_13 = CrossSectionKaramba3D(cross_section_karamba3d_6)
line_to_beam_karamba3d_5 = LineToBeamKaramba3D(
    Line=entwine_5,
    Identifier=graft(panel_5),
    CrossSection=cross_section_karamba3d_13,
    New=True,
    Remove=True,
    LimitDistance_m=0.005,
    Bending=Toggle(True))  # -> Element, Points, Info
element_karamba3d_5 = ElementKaramba3D(flatten(line_to_beam_karamba3d_5.Element))

# ----
# header
curve_16 = Curve([<curve referenced from the Rhino model> x10])
curve_17 = Curve([<curve referenced from the Rhino model> x10])
crv = Curve([<curve referenced from the Rhino model> x2])
entwine_6 = Entwine(Branch00=curve_16, Branch01=curve_17, Branch02=crv, FlattenInputs=True)
panel_6 = Panel("""header1
header2
header3""")
cross_section_karamba3d_14 = CrossSectionKaramba3D(cross_section_karamba3d_7)
line_to_beam_karamba3d_6 = LineToBeamKaramba3D(
    Line=entwine_6,
    Identifier=graft(panel_6),
    CrossSection=cross_section_karamba3d_14,
    New=True,
    Remove=True,
    LimitDistance_m=0.005)  # -> Element, Points, Info
element_karamba3d_6 = ElementKaramba3D(flatten(line_to_beam_karamba3d_6.Element))

pt = Point(<point referenced from the Rhino model>)

pt_2 = Point(<point referenced from the Rhino model>)
pt_3 = Point(<point referenced from the Rhino model>)
pt_4 = Point(<point referenced from the Rhino model>)
pt_5 = Point(<point referenced from the Rhino model>)
pt_6 = Point(<point referenced from the Rhino model>)
pt_7 = Point(<point referenced from the Rhino model>)
pt_8 = Point(<point referenced from the Rhino model>)
pt_9 = Point(<point referenced from the Rhino model>)
pt_10 = Point(<point referenced from the Rhino model>)
pt_11 = Point(<point referenced from the Rhino model>)
pt_12 = Point(<point referenced from the Rhino model>)
pt_13 = Point(<point referenced from the Rhino model>)
merge = Merge(
    Data1=pt_2,
    Data2=pt_5,
    Data3=pt_6,
    Data4=pt_7,
    Data5=pt_8,
    Data6=pt_9,
    Data7=pt_10,
    Data8=pt_11,
    Data9=pt_3,
    Data10=pt_12,
    Data11=pt_13,
    Data12=pt_4)
panel_7 = Panel("robot supports")
pt_14 = Point(<point referenced from the Rhino model>)
pt_15 = Point(<point referenced from the Rhino model>)
pt_16 = Point(<point referenced from the Rhino model>)
pt_17 = Point(<point referenced from the Rhino model>)
pt_18 = Point(<point referenced from the Rhino model>)
pt_19 = Point(<point referenced from the Rhino model>)
pt_20 = Point(<point referenced from the Rhino model>)
pt_21 = Point(<point referenced from the Rhino model>)
pt_22 = Point(<point referenced from the Rhino model>)
pt_23 = Point(<point referenced from the Rhino model>)
merge_2 = Merge(
    Data1=pt,
    Data2=pt_18,
    Data3=pt_15,
    Data4=pt_19,
    Data5=pt_23,
    Data6=pt_16,
    Data7=pt_17,
    Data8=pt_14,
    Data9=pt_20,
    Data10=pt_21,
    Data11=pt_22,
    Data12="null")
num = Number(number_slider)
python = GhPythonScript(rob_1=merge, rob_2=merge_2, n=num)  # -> rob_1_sup, rob_2_sup; inputs rob_1: list, rob_2: list, n: Int32
# ---------- python: Python ----------
if n == -1:
    rob_1_sup = None
    rob_2_sup = None
else:
    rob_1_sup = rob_1[n]
    rob_2_sup = rob_2[n]

print rob_1_sup
# ---------- end python ----------
point_3 = Point(python.rob_1_sup)
point_4 = Point(python.rob_2_sup)
support_karamba3d = SupportKaramba3D(PosInd=point_3, menu=[buttons(on, on, on, off, off, off)])
support_karamba3d_2 = SupportKaramba3D(PosInd=point_4, menu=[buttons(on, on, on, off, off, off)])
support_karamba3d_3 = SupportKaramba3D(support_karamba3d)
support_karamba3d_4 = SupportKaramba3D(support_karamba3d_2)

# ----
# element eliminate
num_2 = Number(number_slider)
python_2 = GhPythonScript(i=num_2)  # -> out, step, m0, m1, m2, m3, m4, m5, m6
# ---------- python_2: Python ----------
step_start = [
[None], #studs
[None], #top plates        
[None], #rafters
[None], #ridge
[None], #joists
[None], #posts
[None], #headers
]

step_dict = {
-1: [
[None], #studs
[None], #top plates        
[None], #rafters
[None], #ridge
[None], #joists
[None], #posts
[None], #headers
],

0: [
[None], #studs
[None], #top plates        
[None], #rafters
[None], #ridge
[None], #joists
[None], #posts
[None], #headers
],

1: [
[None], #studs
[None], #top plates        
[0,7], #rafters
[None], #ridge
[None], #joists
[None], #posts
[None], #headers
],

2: [
[None], #studs
[None], #top plates        
[0,7], #rafters
[None], #ridge
[0], #joists
[None], #posts
[None], #headers
],

3: [
[None], #studs
[None], #top plates        
[0,7,1,8], #rafters
[None], #ridge
[0], #joists
[None], #posts
[None], #headers
],

4: [
[2,11], #studs
[None], #top plates        
[0,7,1,8], #rafters
[None], #ridge
[0], #joists
[None], #posts
[None], #headers
],

5: [
[1,2,10,11], #studs
[None], #top plates        
[0,7,1,8], #rafters
[None], #ridge
[0], #joists
[None], #posts
[None], #headers
],

6: [
[0,1,2,9,10,11], #studs
[None], #top plates        
[0,7,1,8], #rafters
[None], #ridge
[0], #joists
[None], #posts
[None], #headers
],

7: [
[0,1,2,9,10,11], #studs
[0,1,2], #top plates        
[0,7,1,8], #rafters
[None], #ridge
[0], #joists
[None], #posts
[None], #headers
],

8: [
[0,1,2,9,10,11, 46,52], #studs
[0,1,2], #top plates        
[0,7,1,8], #rafters
[None], #ridge
[0], #joists
[None], #posts
[None], #headers
],

9: [
[0,1,2,9,10,11,46,47,52,53], #studs
[0,1,2], #top plates        
[0,7,1,8], #rafters
[None], #ridge
[0], #joists
[None], #posts
[None], #headers
],

10: [
[0,1,2,9,10,11,46,47,48,52,53,54], #studs
[0,1,2], #top plates        
[0,7,1,8], #rafters
[None], #ridge
[0], #joists
[None], #posts
[None], #headers
],

11: [
[0,1,2,9,10,11,46,47,48,49,52,53,54,55,58,59], #studs
[0,1,2], #top plates        
[0,7,1,8], #rafters
[None], #ridge
[0], #joists
[2,3,4,5,6,7,8,9,10], #posts
[0,1,2,3,4,5,6,7,8,9], #headers
],

}

step = step_dict[i]





m0 = step[0]
m1 = step[1]
m2 = step[2]
m3 = step[3]
m4 = step[4]
m5 = step[5]
m6 = step[6]
# ---------- end python_2 ----------
num_3 = Number(python_2.m0)
num_4 = Number(python_2.m1)
num_5 = Number(python_2.m2)
num_6 = Number(python_2.m3)
num_7 = Number(python_2.m4)
num_8 = Number(python_2.m5)
num_9 = Number(python_2.m6)

swatch = ColourSwatch(SwatchColor=RGBA(245, 81, 81, 105))

# ----
# studs
curve_18 = Curve([<curve referenced from the Rhino model> x9])
curve_19 = Curve([<curve referenced from the Rhino model> x6])
curve_20 = Curve([<curve referenced from the Rhino model> x11])
curve_21 = Curve([<curve referenced from the Rhino model> x17])
curve_22 = Curve([<curve referenced from the Rhino model> x5])
merge_3 = Merge(Data1=curve_20, Data2=curve_21)
panel_8 = Panel("""vert_studs1
vert_studs2
vert_studs3
vert_studs4""")
cross_section_karamba3d_15 = CrossSectionKaramba3D(cross_section_karamba3d_5)
panel_9 = Panel("""vert_studs2
vert_studs4""")

# ----
# bottom of studs are supports
merge_4 = Merge(Data1=curve_18, Data2=curve_19, Data3=curve_20, Data4=curve_22)
end_points = EndPoints(Curve=merge_4)  # -> Start, End
point_5 = Point(end_points.Start)
point_6 = Point(point_5)
support_karamba3d_5 = SupportKaramba3D(PosInd=point_6, menu=[buttons(on, on, on, off, off, off)])
support_karamba3d_6 = SupportKaramba3D(support_karamba3d_5)

merge_5 = Merge(Data1=curve_18, Data2=curve)
merge_6 = Merge(Data1=curve_19, Data2=curve_2)

# ----
# group components
joint_karamba3d_3 = JointKaramba3D([joint_karamba3d_2, joint_karamba3d])
load_karamba3d_3 = LoadKaramba3D([load_karamba3d_2, load_karamba3d])
support_karamba3d_7 = SupportKaramba3D([support_karamba3d_6, support_karamba3d_4, support_karamba3d_3])

entwine_7 = Entwine(Branch00=merge_5, Branch01=merge_6, Branch02=merge_3, Branch03=curve_22, FlattenInputs=True)
line_to_beam_karamba3d_7 = LineToBeamKaramba3D(
    Line=entwine_7,
    Identifier=graft(panel_8),
    CrossSection=cross_section_karamba3d_15,
    New=True,
    Remove=True,
    LimitDistance_m=0.005,
    Bending=Toggle(True))  # -> flatten(Element), Points, Info
select_element_karamba3d = SelectElementKaramba3D(Elements=line_to_beam_karamba3d_7.Element, ElementIdentifiers=panel_9)  # -> SelectedElements, RejectedElements
orientate_elem_karamba3d = OrientateElemKaramba3D(Beam=flatten(select_element_karamba3d.SelectedElements), Alpha_deg="90", mode="Beam")

merge_7 = Merge(Data1=flatten(select_element_karamba3d.RejectedElements), Data2=orientate_elem_karamba3d)

element_karamba3d_7 = ElementKaramba3D(flatten(merge_7))

element = ElementKaramba3D(element_karamba3d_7)
element_2 = ElementKaramba3D(element_karamba3d)
element_3 = ElementKaramba3D(element_karamba3d_2)
element_4 = ElementKaramba3D(element_karamba3d_3)
element_5 = ElementKaramba3D(element_karamba3d_4)
element_6 = ElementKaramba3D(element_karamba3d_5)
element_7 = ElementKaramba3D(element_karamba3d_6)
merge_8 = Merge(Data1=element, Data2=element_2, Data3=element_3, Data4=element_4, Data5=element_5, Data6=element_6, Data7=element_7)  # -> flatten(Result)
element_karamba3d_8 = ElementKaramba3D(merge_8)

element_8 = ElementKaramba3D(element_karamba3d_7)
python_3 = GhPythonScript()  # -> boolean_flip
# ---------- python_3: Python ----------
def boolean_flip(flips, on_list):

    for flip in flips:
        
        if flip is not None:
            print flip
            on_list[flip] = False
        
    print on_list
    return on_list
# ---------- end python_3 ----------
disassemble = DisassembleElementKaramba3D(Element=element_8)  # -> Element, ElementIdentifier, AxisOfElement, CrossSection, Joints, Material, LocalCoordinateSystem, ElementIsActive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
num_10 = Number(num_3)
python_4 = GhPythonScript(on_list=disassemble.ElementIsActive, flips=num_10, boolean_flip=python_3)  # -> out, on_list; inputs on_list: list of Boolean, flips: list of Int32
# ---------- python_4: Python ----------
__author__ = "Edvard"
__version__ = "2021.01.28"

import rhinoscriptsyntax as rs

on_list = boolean_flip(flips, on_list)
# ---------- end python_4 ----------
panel_10 = Panel(num_10)
panel_11 = Panel(python_4.on_list)

element_9 = ElementKaramba3D(element_karamba3d)
disassemble_2 = DisassembleElementKaramba3D(Element=element_9)  # -> Element, ElementIdentifier, AxisOfElement, CrossSection, Joints, Material, LocalCoordinateSystem, ElementIsActive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
num_11 = Number(num_4)
python_5 = GhPythonScript(on_list=disassemble_2.ElementIsActive, flips=num_11, boolean_flip=python_3)  # -> out, on_list; inputs on_list: list of Boolean, flips: list of Int32; same code as python_4
panel_12 = Panel(num_11)
panel_13 = Panel(python_5.on_list)

element_10 = ElementKaramba3D(element_karamba3d_2)
disassemble_3 = DisassembleElementKaramba3D(Element=element_10)  # -> Element, ElementIdentifier, AxisOfElement, CrossSection, Joints, Material, LocalCoordinateSystem, ElementIsActive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
num_12 = Number(num_5)
python_6 = GhPythonScript(on_list=disassemble_3.ElementIsActive, flips=num_12, boolean_flip=python_3)  # -> out, on_list; inputs on_list: list of Boolean, flips: list of Int32; same code as python_4
panel_14 = Panel(num_12)
panel_15 = Panel(python_6.on_list)

element_11 = ElementKaramba3D(element_karamba3d_3)
disassemble_4 = DisassembleElementKaramba3D(Element=element_11)  # -> Element, ElementIdentifier, AxisOfElement, CrossSection, Joints, Material, LocalCoordinateSystem, ElementIsActive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
num_13 = Number(num_6)
python_7 = GhPythonScript(on_list=disassemble_4.ElementIsActive, flips=num_13, boolean_flip=python_3)  # -> out, on_list; inputs on_list: list of Boolean, flips: list of Int32; same code as python_4
panel_16 = Panel(num_13)
panel_17 = Panel(python_7.on_list)

element_12 = ElementKaramba3D(element_karamba3d_4)
disassemble_5 = DisassembleElementKaramba3D(Element=element_12)  # -> Element, ElementIdentifier, AxisOfElement, CrossSection, Joints, Material, LocalCoordinateSystem, ElementIsActive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
num_14 = Number(num_7)
python_8 = GhPythonScript(on_list=disassemble_5.ElementIsActive, flips=num_14, boolean_flip=python_3)  # -> out, on_list; inputs on_list: list of Boolean, flips: list of Int32; same code as python_4
panel_18 = Panel(num_14)
panel_19 = Panel(python_8.on_list)

element_13 = ElementKaramba3D(element_karamba3d_6)
disassemble_6 = DisassembleElementKaramba3D(Element=element_13)  # -> Element, ElementIdentifier, AxisOfElement, CrossSection, Joints, Material, LocalCoordinateSystem, ElementIsActive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
num_15 = Number(num_9)
python_9 = GhPythonScript(on_list=disassemble_6.ElementIsActive, flips=num_15, boolean_flip=python_3)  # -> out, on_list; inputs on_list: list of Boolean, flips: list of Int32; same code as python_4
panel_20 = Panel(num_15)
panel_21 = Panel(python_9.on_list)

element_14 = ElementKaramba3D(element_karamba3d_5)
disassemble_7 = DisassembleElementKaramba3D(Element=element_14)  # -> Element, ElementIdentifier, AxisOfElement, CrossSection, Joints, Material, LocalCoordinateSystem, ElementIsActive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
num_16 = Number(num_8)
python_10 = GhPythonScript(on_list=disassemble_7.ElementIsActive, flips=num_16, boolean_flip=python_3)  # -> out, on_list; inputs on_list: list of Boolean, flips: list of Int32; same code as python_4
panel_22 = Panel(num_16)
panel_23 = Panel(python_10.on_list)

merge_9 = Merge(
    Data1=python_4.on_list,
    Data2=python_5.on_list,
    Data3=python_6.on_list,
    Data4=python_7.on_list,
    Data5=python_8.on_list,
    Data6=python_10.on_list,
    Data7=python_9.on_list)

element_karamba3d_9 = ElementKaramba3D(element_karamba3d_8)
support_karamba3d_8 = SupportKaramba3D(support_karamba3d_7)
load_karamba3d_4 = LoadKaramba3D(load_karamba3d_3)
joint_karamba3d_4 = JointKaramba3D(joint_karamba3d_3)
assemble_model_karamba3d = AssembleModelKaramba3D(
    Elem=element_karamba3d_9,
    Support=support_karamba3d_8,
    Load=load_karamba3d_4,
    Joint=joint_karamba3d_4,
    LimitDistance_m=0.005)  # -> Model, Info, Mass_kg, CenterOfGravity
activate = ElementActivationKaramba3D(Model=assemble_model_karamba3d.Model, IsActive=merge_9)
analyze_karamba3d = AnalyzeKaramba3D(Model=activate)  # -> CalculatedModel, MaximumDisplacement_cm, ResultingForceOfGravity_kN, ElasticEnergy_kNm
model_view_karamba3d = ModelViewKaramba3D(Model=analyze_karamba3d.CalculatedModel, ResultFactors=Slider(45, range=1..100), ResultCase=-1)  # -> Model, DeformedMesh, DeformedAxes, DeformedModel
eigen_modes_karamba3d = EigenModesKaramba3D(Model=analyze_karamba3d.CalculatedModel, FromIndex=1, NumberOfModes=1, MaximumNumberOfIterations=300, Epsilon=1e-07)  # -> ModelWithEigenModesAsLoadCaseResults, Eigenvalues
beam_view_karamba3d = BeamViewKaramba3D(Model=model_view_karamba3d.Model)  # -> Model, MeshesOfRenderedBeams, DeformedBeamAxes, LegendColors, LegendTags
model_view_karamba3d_2 = ModelViewKaramba3D(Model=eigen_modes_karamba3d.ModelWithEigenModesAsLoadCaseResults, ResultFactors=Slider(1, range=1..100), ResultCase=-1)  # -> Model, DeformedMesh, DeformedAxes, DeformedModel
legend = Legend(Colour=beam_view_karamba3d.LegendColors, Tags=beam_view_karamba3d.LegendTags, LegendType=1)
mesh = Mesh(beam_view_karamba3d.MeshesOfRenderedBeams)

beam_view_karamba3d_2 = BeamViewKaramba3D(Model=activate)  # -> Model, MeshesOfRenderedBeams, DeformedBeamAxes, LegendColors, LegendTags
merge_10 = Merge(Data1=point_3, Data2=point_4)
mesh_2 = Mesh(beam_view_karamba3d_2.MeshesOfRenderedBeams)
pt_24 = Point(<point referenced from the Rhino model>)
pt_25 = Point([<point referenced from the Rhino model> x118])
crv_2 = Curve([<curve referenced from the Rhino model> x194])
pt_26 = Point(merge_10)
scale = Scale(Geometry=mesh_2, Center=pt_24, Factor="1000")  # -> Geometry, Transform
scale_2 = Scale(Geometry=crv_2, Center=pt_24, Factor="1000")  # -> Geometry, Transform
scale_3 = Scale(Geometry=pt_26, Center=pt_24, Factor="1000")  # -> Geometry, Transform
scale_4 = Scale(Geometry=pt_25, Center=pt_24, Factor="1000")  # -> Geometry, Transform
mesh_3 = Mesh(scale.Geometry)
pt_27 = Point(scale_4.Geometry)
crv_3 = Curve(scale_2.Geometry)
pt_28 = Point(scale_3.Geometry)
preview = CustomPreview(Geometry=pt_28, Shader=ColourSwatch(SwatchColor=RGB(255, 255, 255)))

preview_2 = CustomPreview(Geometry=mesh_3, Shader=swatch)
preview_3 = CustomPreview(Geometry=crv_3, Shader=swatch)
