# Grasshopper definition zerowaste_FEM_backup.gh (Grasshopper 1.0.7)
# plug-ins: karambaGH

# ----
# ROBOT CONNECT
panel = Panel("ros-79hh-s4fg.yaler.io")
ros = ROSConnect(connect=Toggle(True))  # -> ros_client, is_connected; inputs port: Int32, connect: Boolean
#   port ip: The ip address ROS. Defaults to 127.0.0.1.
#   port port: The port of ROS. Defaults to 9090.
#   port connect: If True, connects to ROS. If False, disconnects from ROS. Defaults to False.
#   port ros_client: The ROS client.
#   port is_connected: True if connection established.
# ---------- ros: Python ----------
"""
Connect or disconnect to ROS.

COMPAS FAB v0.19.1
"""
from ghpythonlib.componentbase import executingcomponent as component
from scriptcontext import sticky as st

from compas_fab.backends import RosClient
from compas_fab.ghpython.components import create_id


class ROSConnect(component):
    def RunScript(self, ip, port, connect):
        ros_client = None

        ip = ip or '127.0.0.1'
        port = port or 9090

        key = create_id(self, 'ros_client')
        ros_client = st.get(key, None)

        if ros_client:
            st[key].close()
        if connect:
            st[key] = RosClient(ip, port)
            st[key].run(5)

        ros_client = st.get(key, None)
        is_connected = ros_client.is_connected if ros_client else False
        return (ros_client, is_connected)
# ---------- end ros ----------
data = Data(ros.ros_client)
robot = ROSRobot(ros_client=data, load=Toggle(True))  # -> robot; inputs load: Boolean
#   port ros_client: The ROS client.
#   port load: If True, loads the robot from ROS. Defaults to False.
# ---------- robot: Python ----------
"""
Load robot directly from ROS.

COMPAS FAB v0.19.1
"""
from compas_ghpython.artists import RobotModelArtist
from ghpythonlib.componentbase import executingcomponent as component
from scriptcontext import sticky as st

from compas_fab.ghpython.components import create_id


class ROSRobot(component):
    def RunScript(self, ros_client, load):
        key = create_id(self, 'robot')

        if ros_client and ros_client.is_connected and load:
            # Load URDF from ROS
            st[key] = ros_client.load_robot(load_geometry=True, precision='12f')
            st[key].artist = RobotModelArtist(st[key].model)

        robot = st.get(key, None)
        if robot:  # client sometimes need to be restarted, without needing to reload geometry
            robot.client = ros_client
        return robot
# ---------- end robot ----------
data_2 = Data(robot)

# ----
# disassembly step
number_slider = Slider(-1, range=-1..12)

# ----
# density is a but consverative, could probably go down to 5 kn/m^3
material_selection_karamba3d = MaterialSelectionKaramba3D(menu=[dropdown(4), dropdown(1)])
height = Panel("8.9")
width = Panel("3.8")
height_2 = Panel("8.9")
width_2 = Panel("7.6")
width_3 = Panel("3.8")
height_3 = Panel("14")
width_4 = Panel("8.9")
height_4 = Panel("14")
cross_section_karamba3d = CrossSectionKaramba3D(
    FamilyNameOfCrossSection="DefaultCroSec",
    NameOfCrossSection="2x4",
    Material=material_selection_karamba3d,
    Height_cm=height,
    UpperFlangeWidth_cm=width,
    LowerFlangeWidth_cm=width,
    mode="Trapezoid")
cross_section_karamba3d_2 = CrossSectionKaramba3D(
    FamilyNameOfCrossSection="DefaultCroSec",
    NameOfCrossSection="4x4",
    Material=material_selection_karamba3d,
    Height_cm=height_2,
    UpperFlangeWidth_cm=width_2,
    LowerFlangeWidth_cm=width_2,
    mode="Trapezoid")
cross_section_karamba3d_3 = CrossSectionKaramba3D(
    FamilyNameOfCrossSection="DefaultCroSec",
    NameOfCrossSection="4x6",
    Material=material_selection_karamba3d,
    Height_cm=height_3,
    UpperFlangeWidth_cm=width_4,
    LowerFlangeWidth_cm=width_4,
    mode="Trapezoid")
cross_section_karamba3d_4 = CrossSectionKaramba3D(
    FamilyNameOfCrossSection="DefaultCroSec",
    NameOfCrossSection="2x6",
    Material=material_selection_karamba3d,
    Height_cm=height_4,
    UpperFlangeWidth_cm=width_3,
    LowerFlangeWidth_cm=width_3,
    mode="Trapezoid")
cross_section_karamba3d_5 = CrossSectionKaramba3D(cross_section_karamba3d)
cross_section_karamba3d_6 = CrossSectionKaramba3D(cross_section_karamba3d_2)
cross_section_karamba3d_7 = CrossSectionKaramba3D(cross_section_karamba3d_4)
cross_section_karamba3d_8 = CrossSectionKaramba3D(cross_section_karamba3d_3)

vec = VectorXYZ(XComponent="1000000", YComponent="1000000", ZComponent="1000000")  # -> Vector, Length
vec_2 = VectorXYZ(XComponent="10", YComponent="10", ZComponent="10")  # -> Vector, Length
cross_section_karamba3d_9 = CrossSectionKaramba3D(
    FamilyNameOfCrossSection="DefaultCroSec",
    NameOfCrossSection="spring",
    CTranslation_kN_m=vec.Vector,
    CRotation_kNm_rad=vec_2.Vector,
    mode="Spring")

# ----
# Robot 3
j3 = Slider(23.33, range=-180..75)
j4 = Slider(-18.47, range=-400..400)
j5 = Slider(0, range=-125..120)
j6 = Slider(5.38, range=-400..400)
j1 = Slider(8.48, range=-180..180)
j2 = Slider(-13.22, range=-90..150)
data_3 = Data([j1, j2, j3, j4, j5, j6])

# ----
# Robot 2
j6_2 = Slider(0, range=-400..400)
j1_2 = Slider(0, range=-180..180)
j2_2 = Slider(0, range=-90..150)
j3_2 = Slider(0, range=-180..75)
j4_2 = Slider(0, range=-400..400)
j5_2 = Slider(0, range=-125..120)
track = Slider(1.15, range=0..4)
data_4 = Data([j1_2, j2_2, j3_2, j4_2, j5_2, j6_2, track])

# ----
# Planning Preset
python = GhPythonScript()  # -> config
# ---------- python: Python ----------
#axis 1-6
config = [
40.55,
16.21,
-13.89,
-0.0,
87.68,
130.55]
# ---------- end python ----------
python_2 = GhPythonScript()  # -> config
# ---------- python_2: Python ----------
#ROBOT 1 CONFIG
#Start path planning from

#axis 1-6 + track (mm)
config = [
-37.57,
-3.24,
8.36,
0.19,
84.45,
230,
100]

#config = [
#-37.57,
#-3.24,
#8.36,
#0.19,
#84.45,
#230,
#100]
# ---------- end python_2 ----------
python_3 = GhPythonScript()  # -> config
# ---------- python_3: Python ----------
#ROBOT 1 CONFIG
#Start path planning from

#axis 1-6 + track
config = [
40.55,
16.21,
-13.89,
-0.0,
87.68,
130.55,
3900]

#axis 1-6 + track
#config = [40.55,16.21,-13.89,-0.0,87.68,130.55,3900]
# ---------- end python_3 ----------
config = GhPythonScript(robot=data_2, r1=python_2, r2=python_3, r3=python)  # -> config, config_scaled; inputs r1: list, r2: list, r3: list
# ---------- config: Python ----------
import math

config = robot.zero_configuration()

for i in range(6):
    config['r1_joint_{}'.format(i + 1)] = r1[i]
    config['r2_joint_{}'.format(i + 1)] = r2[i]
    config['r3_joint_{}'.format(i + 1)] = r3[i]

#mm
config['r1_cart_joint'] = r1[6]
config['r2_cart_joint'] = r2[6]

print config

#for use in path planning
#radians and meters
config_scaled = robot.zero_configuration()

for i in range(6):
    config_scaled['r1_joint_{}'.format(i + 1)] = math.radians(r1[i])
    config_scaled['r2_joint_{}'.format(i + 1)] = math.radians(r2[i])
    config_scaled['r3_joint_{}'.format(i + 1)] = math.radians(r3[i])

#mm --> m
config_scaled['r1_cart_joint'] = r1[6]/1000
config_scaled['r2_cart_joint'] = r2[6]/1000

print config_scaled
# ---------- end config ----------

# ----
# Return Preset
python_4 = GhPythonScript()  # -> config
# ---------- python_4: Python ----------
#RETURN CONFIG (BEFORE PICKUP)

#axis 1-6 + track (mm)
config = [
-90.0,
0.0,
0.0,
0.0,
90,
180,
100]
# ---------- end python_4 ----------
python_5 = GhPythonScript()  # -> config
# ---------- python_5: Python ----------
#RETURN CONFIG (BEFORE PICKUP)

#axis 1-6 + track
config = [
90.0,
0.0,
0.0,
0.0,
90,
180,
3900]
# ---------- end python_5 ----------
python_6 = GhPythonScript()  # -> config
# ---------- python_6: Python ----------
#axis 1-6
config = [
90.0,
0.0,
0.0,
0.0,
90,
180]
# ---------- end python_6 ----------
config_2 = GhPythonScript(robot=data_2, r1=python_4, r2=python_5, r3=python_6)  # -> config, config_scaled; inputs r1: list, r2: list, r3: list; same code as config

# ----
# Robot 1
j6_3 = Slider(92.01, range=-400..400)
j1_3 = Slider(0, range=-180..180)
j2_3 = Slider(0, range=-90..150)
j3_3 = Slider(-9.02, range=-180..75)
j4_3 = Slider(-21.24, range=-400..400)
j5_3 = Slider(7.59, range=-125..120)
track_2 = Slider(4, range=0..4)
data_5 = Data([j1_3, j2_3, j3_3, j4_3, j5_3, j6_3, track_2])

cross_section_karamba3d_10 = CrossSectionKaramba3D(cross_section_karamba3d_9)
# supports
point = Point(<point referenced from the Rhino model>)

# ----
# loads
point_2 = Point([<point referenced from the Rhino model> x7])
point_3 = Point(<point referenced from the Rhino model>)
point_4 = Point(point_2)
point_5 = Point(point)
loads_karamba3d = LoadsKaramba3D(ForceVector="-0.1,0,0", Local=False, PosInd=point_4, LCase="1", mode="Point")
loads_karamba3d_2 = LoadsKaramba3D(Vector=Vector(0, 0, -1), LCase=0, mode="Gravity")
loads_karamba3d_3 = LoadsKaramba3D(ForceVector="0,0,-10", Local=False, PosInd=point_5, LCase="2", mode="Point")
load_karamba3d = LoadKaramba3D(loads_karamba3d)
load_karamba3d_2 = LoadKaramba3D(loads_karamba3d_2)

# ----
# joints
panel_2 = Panel("""rafter_main_1
rafter_main_2""")
panel_3 = Panel("""joist
Post_T
Post_B""")
beam_joints_karamba3d = BeamJointsKaramba3D(
    ElementIdentifiers=panel_2,
    CtKNMAtStartingNode=Vector(0, 0, 0),
    CrKNmRadAtStartingNode=Vector(0, 0, 0),
    CtKNMAtEndNode=Vector(0, 0, 0),
    CrKNmRadAtEndNode=Vector(0, 0, 0),
    menu=[buttons(off, off, off, off, off, off), buttons(off, off, off, on, off, on)])
beam_joints_karamba3d_2 = BeamJointsKaramba3D(
    ElementIdentifiers=panel_3,
    CtKNMAtStartingNode=Vector(0, 0, 0),
    CrKNmRadAtStartingNode=Vector(0, 0, 0),
    CtKNMAtEndNode=Vector(0, 0, 0),
    CrKNmRadAtEndNode=Vector(0, 0, 0),
    menu=[buttons(off, off, off, off, on, on), buttons(off, off, off, on, on, on)])
joint_karamba3d = JointKaramba3D(beam_joints_karamba3d)
joint_karamba3d_2 = JointKaramba3D(beam_joints_karamba3d_2)

curve = Curve([<curve referenced from the Rhino model> x7])
curve_2 = Curve(<curve referenced from the Rhino model>)

# ----
# posts
curve_3 = Curve(<curve referenced from the Rhino model>)
entwine = Entwine(Branch00=curve_3, Branch01=curve_2, FlattenInputs=True)
panel_4 = Panel("""Post_T
Post_B""")
cross_section_karamba3d_11 = CrossSectionKaramba3D(cross_section_karamba3d_6)
line_to_beam_karamba3d = LineToBeamKaramba3D(
    Line=entwine,
    Identifier=graft(panel_4),
    CrossSection=cross_section_karamba3d_11,
    New=True,
    Remove=True,
    LimitDistance_m=0.005,
    Bending=Toggle(True))  # -> Element, Points, Info
element_karamba3d = ElementKaramba3D(flatten(line_to_beam_karamba3d.Element))

# ----
# rafters
curve_4 = Curve([<curve referenced from the Rhino model> x7])
curve_5 = Curve([<curve referenced from the Rhino model> x7])
curve_6 = Curve([<curve referenced from the Rhino model> x7])
curve_7 = Curve([<curve referenced from the Rhino model> x7])
entwine_2 = Entwine(Branch00=curve_4, Branch01=curve_5, Branch02=curve_7, Branch03=curve_6, FlattenInputs=True)
panel_5 = Panel("""Rafter_L
rafter_main_1
Rafter_R
rafter_main_2""")
cross_section_karamba3d_12 = CrossSectionKaramba3D(cross_section_karamba3d_7)
line_to_beam_karamba3d_2 = LineToBeamKaramba3D(
    Line=entwine_2,
    Identifier=graft(panel_5),
    CrossSection=cross_section_karamba3d_12,
    New=True,
    Remove=True,
    LimitDistance_m=0.005,
    Bending=Toggle(True))  # -> Element, Points, Info
element_karamba3d_2 = ElementKaramba3D(flatten(line_to_beam_karamba3d_2.Element))

curve_8 = Curve([<curve referenced from the Rhino model> x9])

# ----
# ridge
curve_9 = Curve([<curve referenced from the Rhino model> x6])
entwine_3 = Entwine(Branch00=curve_9, FlattenInputs=True)
cross_section_karamba3d_13 = CrossSectionKaramba3D(cross_section_karamba3d_7)
line_to_beam_karamba3d_3 = LineToBeamKaramba3D(
    Line=entwine_3,
    Identifier="ridge",
    CrossSection=cross_section_karamba3d_13,
    New=True,
    Remove=True,
    LimitDistance_m=0.005,
    Bending=Toggle(True))  # -> Element, Points, Info
element_karamba3d_3 = ElementKaramba3D(flatten(line_to_beam_karamba3d_3.Element))

# ----
# joists
curve_10 = Curve([<curve referenced from the Rhino model> x5])
entwine_4 = Entwine(Branch00=curve_10, FlattenInputs=True)
cross_section_karamba3d_14 = CrossSectionKaramba3D(cross_section_karamba3d_5)
line_to_beam_karamba3d_4 = LineToBeamKaramba3D(
    Line=entwine_4,
    Identifier="Joist",
    CrossSection=cross_section_karamba3d_14,
    New=True,
    Remove=True,
    LimitDistance_m=0.005,
    Bending=Toggle(True))  # -> Element, Points, Info
element_karamba3d_4 = ElementKaramba3D(flatten(line_to_beam_karamba3d_4.Element))

# ----
# connector springs
crv = Curve([<curve referenced from the Rhino model> x3])
crv_2 = Curve([<curve referenced from the Rhino model> x3])
entwine_5 = Entwine(Branch00=crv_2, Branch01=crv, FlattenInputs=True)
panel_6 = Panel("""spring1
spring2""")
cross_section_karamba3d_15 = CrossSectionKaramba3D(cross_section_karamba3d_10)
line_to_beam_karamba3d_5 = LineToBeamKaramba3D(
    Line=entwine_5,
    Identifier=graft(panel_6),
    CrossSection=cross_section_karamba3d_15,
    New=True,
    Remove=True,
    LimitDistance_m=0.005,
    Bending=Toggle(True))  # -> Element, Points, Info
element_karamba3d_5 = ElementKaramba3D(flatten(line_to_beam_karamba3d_5.Element))

pt = Point(<point referenced from the Rhino model>)

pt_2 = Point(<point referenced from the Rhino model>)
pt_3 = Point(<point referenced from the Rhino model>)
pt_4 = Point(<point referenced from the Rhino model>)
pt_5 = Point(<point referenced from the Rhino model>)
pt_6 = Point(<point referenced from the Rhino model>)
pt_7 = Point(<point referenced from the Rhino model>)
pt_8 = Point(<point referenced from the Rhino model>)
pt_9 = Point(<point referenced from the Rhino model>)
pt_10 = Point(<point referenced from the Rhino model>)
pt_11 = Point(<point referenced from the Rhino model>)
pt_12 = Point(<point referenced from the Rhino model>)
pt_13 = Point(<point referenced from the Rhino model>)
merge = Merge(
    Data1=pt_9,
    Data2=pt_2,
    Data3=pt_3,
    Data4=pt_4,
    Data5=pt_5,
    Data6=pt_6,
    Data7=pt_7,
    Data8=pt_8,
    Data9=pt_10,
    Data10=pt_11,
    Data11=pt_12,
    Data12=pt_13)
panel_7 = Panel("robot supports")
pt_14 = Point(<point referenced from the Rhino model>)
pt_15 = Point(<point referenced from the Rhino model>)
pt_16 = Point(<point referenced from the Rhino model>)
pt_17 = Point(<point referenced from the Rhino model>)
pt_18 = Point(<point referenced from the Rhino model>)
pt_19 = Point(<point referenced from the Rhino model>)
pt_20 = Point(<point referenced from the Rhino model>)
pt_21 = Point(<point referenced from the Rhino model>)
pt_22 = Point(<point referenced from the Rhino model>)
pt_23 = Point(<point referenced from the Rhino model>)
merge_2 = Merge(
    Data1=pt,
    Data2=pt_15,
    Data3=pt_16,
    Data4=pt_22,
    Data5=pt_23,
    Data6=pt_17,
    Data7=pt_18,
    Data8=pt_14,
    Data9=pt_19,
    Data10=pt_20,
    Data11=pt_21,
    Data12="null")
num = Number(number_slider)
python_7 = GhPythonScript(rob_1=merge, rob_2=merge_2, n=num)  # -> rob_1_sup, rob_2_sup; inputs rob_1: list, rob_2: list, n: Int32
# ---------- python_7: Python ----------
if n == -1:
    rob_1_sup = None
    rob_2_sup = None
else:
    rob_1_sup = rob_1[n]
    rob_2_sup = rob_2[n]

print rob_1_sup
# ---------- end python_7 ----------
point_6 = Point(python_7.rob_1_sup)
point_7 = Point(python_7.rob_2_sup)
support_karamba3d = SupportKaramba3D(PosInd=point_6, menu=[buttons(on, on, on, off, off, off)])
support_karamba3d_2 = SupportKaramba3D(PosInd=point_7, menu=[buttons(on, on, on, off, off, off)])
support_karamba3d_3 = SupportKaramba3D(support_karamba3d)
support_karamba3d_4 = SupportKaramba3D(support_karamba3d_2)

cross_section_karamba3d_16 = CrossSectionKaramba3D(cross_section_karamba3d_8)
cross_section_karamba3d_17 = CrossSectionKaramba3D(cross_section_karamba3d_5)
python_8 = GhPythonScript()  # -> ele
# ---------- python_8: Python ----------
len = 46

#these are eles in stud wall that are rotated
#at the corners
rotate = [1,7,10,16,19,27,30,35]

ele = []

for i in range(len):
    if i in rotate:
        ele.append(True)
    else:
        ele.append(False)
    


print ele
# ---------- end python_8 ----------
load_karamba3d_3 = LoadKaramba3D(loads_karamba3d_3)
element = ElementKaramba3D(element_karamba3d_5)

# ----
# element eliminate
num_2 = Number(number_slider)
python_9 = GhPythonScript(i=num_2)  # -> out, step, m0, m1, m2, m3, m4, m5, m6
# ---------- python_9: Python ----------
step_start = [
[None], #studs
[None], #top plates        
[None], #rafters
[None], #ridge
[None], #joists
[None], #posts
[None], #headers
]

step_dict = {
-1: [
[None], #studs
[None], #top plates        
[None], #rafters
[None], #ridge
[None], #joists
[None], #posts
[None], #headers
],

0: [
[None], #studs
[None], #top plates        
[None], #rafters
[None], #ridge
[None], #joists
[None], #posts
[None], #headers
],

1: [
[None], #studs
[None], #top plates        
[0,7], #rafters
[None], #ridge
[None], #joists
[None], #posts
[None], #headers
],

2: [
[None], #studs
[None], #top plates        
[0,7], #rafters
[None], #ridge
[0], #joists
[None], #posts
[None], #headers
],

3: [
[None], #studs
[None], #top plates        
[0,7,1,8], #rafters
[None], #ridge
[0], #joists
[None], #posts
[None], #headers
],

4: [
[2,11], #studs
[None], #top plates        
[0,7,1,8], #rafters
[None], #ridge
[0], #joists
[None], #posts
[None], #headers
],

5: [
[1,2,10,11], #studs
[None], #top plates        
[0,7,1,8], #rafters
[None], #ridge
[0], #joists
[None], #posts
[None], #headers
],

6: [
[0,1,2,9,10,11], #studs
[None], #top plates        
[0,7,1,8], #rafters
[None], #ridge
[0], #joists
[None], #posts
[None], #headers
],

7: [
[0,1,2,9,10,11], #studs
[0,1,2], #top plates        
[0,7,1,8], #rafters
[None], #ridge
[0], #joists
[None], #posts
[None], #headers
],

8: [
[0,1,2,9,10,11, 46,52], #studs
[0,1,2], #top plates        
[0,7,1,8], #rafters
[None], #ridge
[0], #joists
[None], #posts
[None], #headers
],

9: [
[0,1,2,9,10,11,46,47,52,53], #studs
[0,1,2], #top plates        
[0,7,1,8], #rafters
[None], #ridge
[0], #joists
[None], #posts
[None], #headers
],

10: [
[0,1,2,9,10,11,46,47,48,52,53,54], #studs
[0,1,2], #top plates        
[0,7,1,8], #rafters
[None], #ridge
[0], #joists
[None], #posts
[None], #headers
],

11: [
[0,1,2,9,10,11,46,47,48,49,52,53,54,55,58,59], #studs
[0,1,2], #top plates        
[0,7,1,8], #rafters
[None], #ridge
[0], #joists
[2,3,4,5,6,7,8,9,10], #posts
[0,1,2,3,4,5,6,7,8,9], #headers
],

}

step = step_dict[i]





m0 = step[0]
m1 = step[1]
m2 = step[2]
m3 = step[3]
m4 = step[4]
m5 = step[5]
m6 = step[6]
# ---------- end python_9 ----------
num_3 = Number(python_9.m0)
num_4 = Number(python_9.m2)
num_5 = Number(python_9.m3)
num_6 = Number(python_9.m4)
num_7 = Number(python_9.m1)
num_8 = Number(python_9.m5)
num_9 = Number(python_9.m6)

swatch = ColourSwatch(SwatchColor=RGBA(245, 81, 81, 105))

# ----
# If axis is included then allow the robot to move along track
list = ValueList({"Robot 1": 1, "Robot 2": 2, "Robot 3": 3}, selected="Robot 1")
rob_num = Number(list)
list_2 = ValueList({"Robot 1 - No Track, No Gripper": "robot1_notrack", "Robot 1 - No Track, Gripper": "robot1_notrack_gripper", "Robot 1 - Track, No Gripper": "robot1_track", "Robot 1 - Track, Gripper": "robot1_track_gripper"}, selected="Robot 1 - Track, Gripper")
list_3 = ValueList({"Robot 2 - No Track, No Gripper": "robot2_notrack", "Robot 2 - No Track, Gripper": "robot2_notrack_gripper", "Robot 2 - Track, No Gripper": "robot2_track", "Robot 2 - Track, Gripper": "robot2_track_gripper"}, selected="Robot 2 - Track, Gripper")
list_4 = ValueList({"Robot 3 - No Gripper": "robot3", "Robot 3 - Gripper": "robot3_gripper"}, selected="Robot 3 - Gripper")
list_5 = ValueList({"platform": "ecl_platform", "world": "ecl_zero", "wobj_1": "rob1_acadia_EBIT_01", "wobj_2": "rob2_acadia_EBIT_01"}, selected="wobj_1")
list_6 = ValueList({"platform": "ecl_platform", "world": "ecl_zero", "wobj_1": "rob1_acadia_EBIT_01", "wobj_2": "rob2_acadia_EBIT_01"}, selected="wobj_2")
list_7 = ValueList({"platform": "ecl_platform", "world": "ecl_zero", "wobj_1": "rob1_acadia_EBIT_01", "wobj_2": "rob2_acadia_EBIT_01"}, selected="wobj_2")
data_6 = Data(list_2)
data_7 = Data(list_3)
panel_8 = Panel(rob_num)
panel_9 = Panel(rob_num)
filter = StreamFilter(Gate=panel_8, Stream1=list_5, Stream2=list_6, Stream3=list_7)
data_8 = Data(filter)

data_9 = Data(list_4)

filter_2 = StreamFilter(Gate=panel_9, Stream1=data_6, Stream2=data_7, Stream3=data_9)
data_10 = Data(filter_2)

# ----
# move/rotate plane around on rhino canvas
crv_3 = Curve(<curve referenced from the Rhino model>)
crv_4 = Curve(<curve referenced from the Rhino model>)
# INVERSE KINEMATICS
pt_24 = Point(<point referenced from the Rhino model>)
crv_5 = Curve(<curve referenced from the Rhino model>)
crv_6 = Curve(<curve referenced from the Rhino model>)
pt_25 = Point(<point referenced from the Rhino model>)
crv_7 = Curve(<curve referenced from the Rhino model>)
pt_26 = Point(<point referenced from the Rhino model>)
# PRESET CONFIGS
crv_8 = Curve(<curve referenced from the Rhino model>)
pl = ConstructPlane(Origin=pt_24, XAxis=crv_5, YAxis=crv_6)
pl_2 = ConstructPlane(Origin=pt_25, XAxis=crv_3, YAxis=crv_7)
pl_3 = ConstructPlane(Origin=pt_26, XAxis=crv_4, YAxis=crv_8)
panel_10 = Panel(rob_num)
filter_3 = StreamFilter(Gate=panel_10, Stream1=pl, Stream2=pl_2, Stream3=pl_3)

# ----
# FORWARD KINEMATICS
config_3 = GhPythonScript(robot=data_2, r1=data_5, r2=data_4, r3=data_3)  # -> config; inputs r1: list, r2: list, r3: list
# ---------- config_3: Python ----------
import math

config = robot.zero_configuration()

for i in range(6):
    config['r1_joint_{}'.format(i + 1)] = math.radians(r1[i])
    config['r2_joint_{}'.format(i + 1)] = math.radians(r2[i])
    config['r3_joint_{}'.format(i + 1)] = math.radians(r3[i])

config['r1_cart_joint'] = r1[6]
config['r2_cart_joint'] = r2[6]

print config
# ---------- end config_3 ----------
gripper_frames = GhPythonScript(robot=data_2, group=data_10, config=config_3)  # -> out
# ---------- gripper_frames: Python ----------
print repr(robot.forward_kinematics(config, group=group))
# ---------- end gripper_frames ----------
panel_11 = Panel(gripper_frames)

use_fk_as_start = BooleanToggle(True)
data_11 = Data(config_3)
filter_4 = StreamFilter(Gate=use_fk_as_start, Stream1=data_11)
pln = Plane(filter_3)
data_12 = Data(filter_4)
ik = InverseKinematics(robot=data_2, plane=pln, start_configuration=data_12, group=data_10)  # -> configuration
#   port plane: The plane or frame to calculate the inverse kinematic for.
#   port start_configuration: If passed, calculates the inverse such that the joint positions differ the least from the start_configuration. Defaults to the zero configuration.
#   port group: The planning group used for calculation. Defaults to the robot's main planning group.
#   port configuration: The planning group's configuration.
# ---------- ik: Python ----------
"""
Calculate the robot's inverse kinematic for a given plane.

COMPAS FAB v0.19.1
"""
from ghpythonlib.componentbase import executingcomponent as component

from compas_fab.ghpython.components import coerce_frame


class InverseKinematics(component):
    def RunScript(self, robot, plane, start_configuration, group):
        configuration = None
        if robot and robot.client and robot.client.is_connected and plane:
            frame = coerce_frame(plane)
            configuration = robot.inverse_kinematics(frame, start_configuration, group)
        if start_configuration:
            return start_configuration.merged(configuration)
        else:
            return configuration
# ---------- end ik ----------

list_8 = ValueList({"Forward Kinematics": 0, "Inverse Kinematics": 1, "Preset Start Planning Config": 2, "Preset Return Config": 3}, selected="Inverse Kinematics")
filter_5 = StreamFilter(Gate=list_8, Stream0=config_3, Stream1=ik, Stream2=config.config_scaled, Stream3=config_2.config_scaled)
robot_visualize = RobotVisualize(
    robot=data_2,
    group=data_10,
    configuration=filter_5,
    show_visual=Toggle(True),
    show_collision=Toggle(False),
    show_end_effector_frame=Toggle(True))  # -> visual, collision, attached_meshes, frames, base_frame, ee_frame; inputs attached_collision_meshes: list, show_visual: Boolean, show_collision: Boolean, show_frames: Boolean, show_base_frame: Boolean, show_end_effector_frame: Boolean, show_acm: Boolean
#   port group: The planning group used for end-effector and base visualization.
#   port configuration: The robot's full configuration.
#   port attached_collision_meshes: A list of attached collision meshes.
#   port show_visual: Whether or not to show the robot's visual meshes.
#   port show_collision: Whether or not to show the robot's collision meshes.
#   port show_frames: Whether or not to show the robot's joint frames.
#   port show_base_frame: Whether or not to show the robot's base frame.
#   port show_end_effector_frame: Whether or not to show the robot's end-effector frame.
#   port show_acm: Whether or not to show the attached collision meshes (if any).
#   port visual: The robot's visual Rhino meshes (if any).
#   port collision: The robot's collision Rhino meshes (if any).
#   port attached_meshes: The attached collision Rhino meshes (if any).
#   port frames: The robot's joint frames as Rhino planes (if any).
#   port base_frame: The robot's base frame as a Rhino plane (if any).
#   port ee_frame: The robot's end-effector frame as a Rhino plane (if any).
# ---------- robot_visualize: Python ----------
"""
Visualizes the robot.

COMPAS FAB v0.19.1
"""
from compas.geometry import Frame
from compas.geometry import Transformation
from compas_ghpython.artists import FrameArtist
from compas_ghpython.artists import MeshArtist
from ghpythonlib.componentbase import executingcomponent as component


class RobotVisualize(component):
    def RunScript(self, robot, group, configuration, attached_collision_meshes, show_visual, show_collision,
                  show_frames, show_base_frame, show_end_effector_frame, show_acm):

        visual = None
        collision = None
        attached_meshes = None
        frames = None
        base_frame = None
        ee_frame = None

        if robot:
            show_visual = True if show_visual is None else show_visual
            configuration = configuration or robot.zero_configuration()

            robot.update(configuration, visual=show_visual, collision=show_collision)
            compas_frames = robot.transformed_frames(configuration, group)

            if show_visual:
                visual = robot.artist.draw_visual()

            if show_collision:
                collision = robot.artist.draw_collision()

            if show_base_frame:
                base_compas_frame = compas_frames[0]
                artist = FrameArtist(base_compas_frame)
                base_frame = artist.draw()

            if show_end_effector_frame:
                ee_compas_frame = robot.forward_kinematics(configuration, group, options=dict(solver='model'))
                artist = FrameArtist(ee_compas_frame)
                ee_frame = artist.draw()

            if show_frames:
                frames = []
                for compas_frame in compas_frames[1:]:
                    artist = FrameArtist(compas_frame)
                    frame = artist.draw()
                    frames.append(frame)

            if show_acm:
                attached_meshes = []
                for acm in attached_collision_meshes:
                    frame = robot.forward_kinematics(configuration, options=dict(solver='model', link_name=acm.link_name))
                    T = Transformation.from_frame_to_frame(Frame.worldXY(), frame)
                    mesh = acm.collision_mesh.mesh.transformed(T)
                    attached_meshes.append(MeshArtist(mesh).draw())

        return (visual, collision, attached_meshes, frames, base_frame, ee_frame)
# ---------- end robot_visualize ----------

# ----
# top plate
curve_11 = Curve([<curve referenced from the Rhino model> x8])
curve_12 = Curve([<curve referenced from the Rhino model> x8])
curve_13 = Curve([<curve referenced from the Rhino model> x10])
curve_14 = Curve([<curve referenced from the Rhino model> x6])
entwine_6 = Entwine(Branch00=curve_12, Branch01=curve_11, Branch02=curve_13, Branch03=curve_14, FlattenInputs=True)
panel_12 = Panel("""top_plate1
top_plate2
top_plate3
top_plate4""")
cross_section_karamba3d_18 = CrossSectionKaramba3D(cross_section_karamba3d_6)
line_to_beam_karamba3d_6 = LineToBeamKaramba3D(
    Line=entwine_6,
    Identifier=graft(panel_12),
    CrossSection=cross_section_karamba3d_18,
    New=True,
    Remove=True,
    LimitDistance_m=0.005,
    Bending=Toggle(True))  # -> Element, Points, Info

orientate_elem_karamba3d = OrientateElemKaramba3D(Beam=flatten(line_to_beam_karamba3d_6.Element), Alpha_deg="90", mode="Beam")

element_karamba3d_6 = ElementKaramba3D(flatten(orientate_elem_karamba3d))

# ----
# studs
curve_15 = Curve([<curve referenced from the Rhino model> x6])
curve_16 = Curve([<curve referenced from the Rhino model> x11])
curve_17 = Curve([<curve referenced from the Rhino model> x9])
curve_18 = Curve([<curve referenced from the Rhino model> x15])
curve_19 = Curve([<curve referenced from the Rhino model> x5])
merge_3 = Merge(Data1=curve_16, Data2=curve_18)
panel_13 = Panel("""Stud_L
Stud_B
Stud_R
Stud_T""")
cross_section_karamba3d_19 = CrossSectionKaramba3D(cross_section_karamba3d_5)
panel_14 = Panel("""Stud_L
Stud_R""")

# ----
# bottom of studs are supports
merge_4 = Merge(Data1=curve_17, Data2=curve_15, Data3=curve_16, Data4=curve_19)
end_points = EndPoints(Curve=merge_4)  # -> Start, End
point_8 = Point(end_points.Start)
point_9 = Point(point_8)
support_karamba3d_5 = SupportKaramba3D(PosInd=point_9, menu=[buttons(on, on, on, off, off, off)])
support_karamba3d_6 = SupportKaramba3D(support_karamba3d_5)

merge_5 = Merge(Data1=curve_17, Data2=curve_8)
merge_6 = Merge(Data1=curve_15, Data2=curve)

# ----
# group components
joint_karamba3d_3 = JointKaramba3D([joint_karamba3d_2, joint_karamba3d])
load_karamba3d_4 = LoadKaramba3D([load_karamba3d_2, load_karamba3d, load_karamba3d_3])
support_karamba3d_7 = SupportKaramba3D([support_karamba3d_6, support_karamba3d_4, support_karamba3d_3])

# ----
# header
curve_20 = Curve([<curve referenced from the Rhino model> x2])
curve_21 = Curve([<curve referenced from the Rhino model> x2])
crv_9 = Curve([<curve referenced from the Rhino model> x2])
cross_section_karamba3d_20 = CrossSectionKaramba3D(cross_section_karamba3d_8)
entwine_7 = Entwine(Branch00=curve_20, Branch01=curve_21, Branch02=crv_9, FlattenInputs=True)
panel_15 = Panel("""Header_B
Header_R1
Header_R2""")

entwine_8 = Entwine(
    Branch00=cross_section_karamba3d_20,
    Branch01=cross_section_karamba3d_16,
    Branch02=cross_section_karamba3d_17,
    FlattenInputs=True)

entwine_9 = Entwine(Branch00=merge_5, Branch01=merge_6, Branch02=merge_3, Branch03=curve_19, FlattenInputs=True)
line_to_beam_karamba3d_7 = LineToBeamKaramba3D(
    Line=entwine_9,
    Identifier=graft(panel_13),
    CrossSection=cross_section_karamba3d_19,
    New=True,
    Remove=True,
    LimitDistance_m=0.005,
    Bending=Toggle(True))  # -> flatten(Element), Points, Info
select_element_karamba3d = SelectElementKaramba3D(Elements=line_to_beam_karamba3d_7.Element, ElementIdentifiers=panel_14)  # -> SelectedElements, RejectedElements

dispatch = Dispatch(List=flatten(select_element_karamba3d.SelectedElements), DispatchPattern=python_8)  # -> ListA, ListB

line_to_beam_karamba3d_8 = LineToBeamKaramba3D(Line=entwine_7, Identifier=graft(panel_15), CrossSection=entwine_8, New=True, Remove=True, LimitDistance_m=0.005)  # -> flatten(Element), Points, Info

select_element_karamba3d_2 = SelectElementKaramba3D(Elements=line_to_beam_karamba3d_8.Element, ElementIdentifiers="Header_R2")  # -> SelectedElements, RejectedElements
orientate_elem_karamba3d_2 = OrientateElemKaramba3D(Beam=flatten(select_element_karamba3d_2.SelectedElements), Alpha_deg="90", mode="Beam")
merge_7 = Merge(Data1=flatten(select_element_karamba3d_2.RejectedElements), Data2=orientate_elem_karamba3d_2)

element_karamba3d_7 = ElementKaramba3D(flatten(merge_7))

orientate_elem_karamba3d_3 = OrientateElemKaramba3D(Beam=flatten(dispatch.ListB), Alpha_deg="90", mode="Beam")

merge_8 = Merge(Data1=flatten(select_element_karamba3d.RejectedElements), Data2=dispatch.ListA, Data3=orientate_elem_karamba3d_3)

element_karamba3d_8 = ElementKaramba3D(flatten(merge_8))

element_2 = ElementKaramba3D(element_karamba3d_8)
element_3 = ElementKaramba3D(element_karamba3d)
element_4 = ElementKaramba3D(element_karamba3d_6)
element_5 = ElementKaramba3D(element_karamba3d_2)
element_6 = ElementKaramba3D(element_karamba3d_3)
element_7 = ElementKaramba3D(element_karamba3d_4)
element_8 = ElementKaramba3D(element_karamba3d_7)
merge_9 = Merge(
    Data1=element_2,
    Data2=element_4,
    Data3=element_5,
    Data4=element_6,
    Data5=element_7,
    Data6=element_3,
    Data7=element_8,
    Data8=element)  # -> flatten(Result)
element_karamba3d_9 = ElementKaramba3D(merge_9)

element_9 = ElementKaramba3D(element_karamba3d_8)
python_10 = GhPythonScript()  # -> boolean_flip
# ---------- python_10: Python ----------
def boolean_flip(flips, on_list):

    for flip in flips:
        
        if flip is not None:
            print flip
            on_list[flip] = False
        
    print on_list
    return on_list
# ---------- end python_10 ----------
disassemble = DisassembleElementKaramba3D(Element=element_9)  # -> Element, ElementIdentifier, AxisOfElement, CrossSection, Joints, Material, LocalCoordinateSystem, ElementIsActive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
num_10 = Number(num_3)
python_11 = GhPythonScript(on_list=disassemble.ElementIsActive, flips=num_10, boolean_flip=python_10)  # -> out, on_list; inputs on_list: list of Boolean, flips: list of Int32
# ---------- python_11: Python ----------
__author__ = "Edvard"
__version__ = "2021.01.28"

import rhinoscriptsyntax as rs

on_list = boolean_flip(flips, on_list)
# ---------- end python_11 ----------
panel_16 = Panel(num_10)
panel_17 = Panel(python_11.on_list)

element_10 = ElementKaramba3D(element_karamba3d_6)
disassemble_2 = DisassembleElementKaramba3D(Element=element_10)  # -> Element, ElementIdentifier, AxisOfElement, CrossSection, Joints, Material, LocalCoordinateSystem, ElementIsActive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
num_11 = Number(num_7)
python_12 = GhPythonScript(on_list=disassemble_2.ElementIsActive, flips=num_11, boolean_flip=python_10)  # -> out, on_list; inputs on_list: list of Boolean, flips: list of Int32; same code as python_11
panel_18 = Panel(num_11)
panel_19 = Panel(python_12.on_list)

element_11 = ElementKaramba3D(element_karamba3d_2)
disassemble_3 = DisassembleElementKaramba3D(Element=element_11)  # -> Element, ElementIdentifier, AxisOfElement, CrossSection, Joints, Material, LocalCoordinateSystem, ElementIsActive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
num_12 = Number(num_4)
python_13 = GhPythonScript(on_list=disassemble_3.ElementIsActive, flips=num_12, boolean_flip=python_10)  # -> out, on_list; inputs on_list: list of Boolean, flips: list of Int32; same code as python_11
panel_20 = Panel(num_12)
panel_21 = Panel(python_13.on_list)

element_12 = ElementKaramba3D(element_karamba3d_3)
disassemble_4 = DisassembleElementKaramba3D(Element=element_12)  # -> Element, ElementIdentifier, AxisOfElement, CrossSection, Joints, Material, LocalCoordinateSystem, ElementIsActive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
num_13 = Number(num_5)
python_14 = GhPythonScript(on_list=disassemble_4.ElementIsActive, flips=num_13, boolean_flip=python_10)  # -> out, on_list; inputs on_list: list of Boolean, flips: list of Int32; same code as python_11
panel_22 = Panel(num_13)
panel_23 = Panel(python_14.on_list)

element_13 = ElementKaramba3D(element_karamba3d_4)
disassemble_5 = DisassembleElementKaramba3D(Element=element_13)  # -> Element, ElementIdentifier, AxisOfElement, CrossSection, Joints, Material, LocalCoordinateSystem, ElementIsActive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
num_14 = Number(num_6)
python_15 = GhPythonScript(on_list=disassemble_5.ElementIsActive, flips=num_14, boolean_flip=python_10)  # -> out, on_list; inputs on_list: list of Boolean, flips: list of Int32; same code as python_11
panel_24 = Panel(num_14)
panel_25 = Panel(python_15.on_list)

element_14 = ElementKaramba3D(element_karamba3d_7)
disassemble_6 = DisassembleElementKaramba3D(Element=element_14)  # -> Element, ElementIdentifier, AxisOfElement, CrossSection, Joints, Material, LocalCoordinateSystem, ElementIsActive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
num_15 = Number(num_9)
python_16 = GhPythonScript(on_list=disassemble_6.ElementIsActive, flips=num_15, boolean_flip=python_10)  # -> out, on_list; inputs on_list: list of Boolean, flips: list of Int32; same code as python_11
panel_26 = Panel(num_15)
panel_27 = Panel(python_16.on_list)

element_15 = ElementKaramba3D(element_karamba3d)
disassemble_7 = DisassembleElementKaramba3D(Element=element_15)  # -> Element, ElementIdentifier, AxisOfElement, CrossSection, Joints, Material, LocalCoordinateSystem, ElementIsActive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
num_16 = Number(num_8)
python_17 = GhPythonScript(on_list=disassemble_7.ElementIsActive, flips=num_16, boolean_flip=python_10)  # -> out, on_list; inputs on_list: list of Boolean, flips: list of Int32; same code as python_11
panel_28 = Panel(num_16)
panel_29 = Panel(python_17.on_list)

merge_10 = Merge(
    Data1=python_11.on_list,
    Data2=python_12.on_list,
    Data3=python_13.on_list,
    Data4=python_14.on_list,
    Data5=python_15.on_list,
    Data6=python_17.on_list,
    Data7=python_16.on_list)

support_karamba3d_8 = SupportKaramba3D(support_karamba3d_7)
load_karamba3d_5 = LoadKaramba3D(load_karamba3d_4)
element_karamba3d_10 = ElementKaramba3D(element_karamba3d_9)
joint_karamba3d_4 = JointKaramba3D(joint_karamba3d_3)
assemble_model_karamba3d = AssembleModelKaramba3D(
    Elem=element_karamba3d_10,
    Support=support_karamba3d_8,
    Load=load_karamba3d_5,
    Joint=joint_karamba3d_4,
    LimitDistance_m=0.005)  # -> Model, Info, Mass_kg, CenterOfGravity
activate = ElementActivationKaramba3D(Model=assemble_model_karamba3d.Model, IsActive=merge_10)
analyze_karamba3d = AnalyzeKaramba3D(Model=activate)  # -> CalculatedModel, MaximumDisplacement_cm, ResultingForceOfGravity_kN, ElasticEnergy_kNm
model_view_karamba3d = ModelViewKaramba3D(Model=analyze_karamba3d.CalculatedModel, ResultFactors=Slider(49, range=1..100), ResultCase=-1)  # -> Model, DeformedMesh, DeformedAxes, DeformedModel
eigen_modes_karamba3d = EigenModesKaramba3D(Model=analyze_karamba3d.CalculatedModel, FromIndex=1, NumberOfModes=1, MaximumNumberOfIterations=300, Epsilon=1e-07)  # -> ModelWithEigenModesAsLoadCaseResults, Eigenvalues
beam_view_karamba3d = BeamViewKaramba3D(Model=model_view_karamba3d.Model)  # -> Model, MeshesOfRenderedBeams, DeformedBeamAxes, LegendColors, LegendTags
model_view_karamba3d_2 = ModelViewKaramba3D(Model=eigen_modes_karamba3d.ModelWithEigenModesAsLoadCaseResults, ResultFactors=Slider(1, range=1..100), ResultCase=-1)  # -> Model, DeformedMesh, DeformedAxes, DeformedModel
legend = Legend(Colour=beam_view_karamba3d.LegendColors, Tags=beam_view_karamba3d.LegendTags, LegendType=1)
mesh = Mesh(beam_view_karamba3d.MeshesOfRenderedBeams)

beam_view_karamba3d_2 = BeamViewKaramba3D(Model=activate)  # -> Model, MeshesOfRenderedBeams, DeformedBeamAxes, LegendColors, LegendTags
merge_11 = Merge(Data1=point_6, Data2=point_7)
mesh_2 = Mesh(beam_view_karamba3d_2.MeshesOfRenderedBeams)
pt_27 = Point(<point referenced from the Rhino model>)
pt_28 = Point([<point referenced from the Rhino model> x118])
crv_10 = Curve([<curve referenced from the Rhino model> x194])
pt_29 = Point(merge_11)
scale = Scale(Geometry=mesh_2, Center=pt_27, Factor="1000")  # -> Geometry, Transform
scale_2 = Scale(Geometry=crv_10, Center=pt_27, Factor="1000")  # -> Geometry, Transform
scale_3 = Scale(Geometry=pt_29, Center=pt_27, Factor="1000")  # -> Geometry, Transform
scale_4 = Scale(Geometry=pt_28, Center=pt_27, Factor="1000")  # -> Geometry, Transform
pt_30 = Point(scale_4.Geometry)
mesh_3 = Mesh(scale.Geometry)
crv_11 = Curve(scale_2.Geometry)
pt_31 = Point(scale_3.Geometry)
preview = CustomPreview(Geometry=pt_31, Shader=ColourSwatch(SwatchColor=RGB(255, 255, 255)))

preview_2 = CustomPreview(Geometry=mesh_3, Shader=swatch)
preview_3 = CustomPreview(Geometry=crv_11, Shader=swatch)
