# Grasshopper definition view_points.ghx (Grasshopper 1.0.7)

# ----
# SET POINTS MANUALLY FROM RHINO FILE
spacing = Panel("0.0030")
min_error = Panel("0.0001")
iterations = Panel("100")
pt = Point()

# ----
# initializing the cluster centroids with one point in each cluster helps to avoid double centroids in one cluster which happens when randomly seeding the volume
dist = Distance(PointA=pt, PointB=graft(pt))  # -> simplify(Distance)
smaller = SmallerThan(FirstNumber=dist, SecondNumber=spacing)  # -> SmallerThan, OrEqualTo
mindex = MemberIndex(Set=smaller.SmallerThan, Member=Toggle(True))  # -> simplify(Index), Count
python = GhPythonScript(inputTree=mindex.Index)  # -> out, save_list; inputs inputTree: tree
# ---------- python: Python ----------
idx_list = []

n_pnts = inputTree.BranchCount
print n_pnts

cull_list = []
save_list = []

for i in range(inputTree.BranchCount):
    
    print("\nBRANCH #:",i)
    
    if i not in cull_list:
        save_list.append(i)
        cull_list.append(i)
        
        inputThisBranch = inputTree.Branch(i)
        print inputThisBranch
        
        for j in inputThisBranch:
            
            if j in cull_list:
                pass
            else:
                cull_list.append(j)
                
        
#        pathLength = inputTree.Path(i).Length
#        pathFirstNumber = inputTree.Path(i)[0]
#        idx_list.append(pathFirstNumber)

print save_list
# ---------- end python ----------
item = ListItem(List=pt, Index=python.save_list, Wrap=True)

pdecon = Deconstruct(Point=pt)  # -> XComponent, YComponent, ZComponent
bnd = Bounds(Numbers=pdecon.XComponent)
bnd_2 = Bounds(Numbers=pdecon.YComponent)
bnd_3 = Bounds(Numbers=pdecon.ZComponent)
box = DomainBox(Base=PlaneXY(0, 0, 0), X=bnd, Y=bnd_2, Z=bnd_3)
pop3d = Populate3D(Region=box, Count="250", Seed=1)

pt_2 = Point(item)
preview = CustomPreview(Geometry=pt_2, Material=ColourSwatch(SwatchColor=RGB(255, 242, 0)))  # disabled

pt_3 = ConstructPoint(XCoordinate=0, YCoordinate=0, ZCoordinate=0)
lng = ListLength(List=pt_2)
dup = DuplicateData(Data=pt_3, Number=lng, Order=True)
python_2 = GhPythonScript(points=pt, centroid_start=pt_2, centroid_0=dup, min_error=min_error, max_iteration=iterations, n_cluster=lng)  # -> out, cluster_centroids, simplify(clusters); inputs points: list of Point3d, centroid_start: list of Point3d, centroid_0: list of Point3d, max_iteration: Int32, n_cluster: Int32
# ---------- python_2: Python ----------
import rhinoscriptsyntax as rs
from copy import deepcopy
from Rhino.Geometry import Point3d
import ghpythonlib.treehelpers as th

# Check euclidean distance between two centroid lists
def error_centroids(centroids_new, centroids_old):
    errors = []
    
    for c_new, c_old in zip(centroids_new, centroids_old):
        errors.append(rs.Distance(c_new,c_old))
        
    if any(i >= min_error for i in errors):
        print ("not converged:", max(errors))
        return True
    else:
        print ("converged", max(errors))
        return False

iter = 1
centroids_old = centroid_0
centroids_new = centroid_start

while error_centroids(centroids_new, centroids_old) and iter<max_iteration:
    print("ITERATION #",iter)
    centroids_old = deepcopy(centroids_new)
        
    #initialize cluster list of lists
    sorted_points = [[] for _ in range(n_cluster)]
        
    #assign points to cluster based on closest centroid
    for x in points:
        dists = rs.Distance(x,centroids_new)
        centroid_idx = dists.index(min(dists))
        sorted_points[centroid_idx].append(x)
        
    # calculate new centroids based on cluster
    for i,cluster in enumerate(sorted_points):
        
        
        cluster_len = len(cluster)
        
        #if there are points in cluster, find average
        #otherwise copy old value
        if cluster_len:
            print "cluster #",i, "NOT EMPTY"
            sum_pnt = [0,0,0]
            
            for p in cluster:
                sum_pnt[0] += p.X
                sum_pnt[1] += p.Y
                sum_pnt[2] += p.Z
                
            sum_pnt = [x/cluster_len for x in sum_pnt]
            centroids_new[i] = rs.CreatePoint(sum_pnt)
        else:
            print "cluster #",i, "EMPTY"
            centroids_new[i] = deepcopy(centroids_old[i])
    
    
    iter += 1

cluster_centroids = centroids_new
clusters = th.list_to_tree(sorted_points)
# ---------- end python_2 ----------
clean = CleanTree(RemoveNulls=True, RemoveInvalid=True, RemoveEmpty=True, Tree=python_2.clusters)
pt_4 = Point(python_2.cluster_centroids)

python_3 = GhPythonScript(inputTree=clean)  # -> out, idx_list; inputs inputTree: tree
# ---------- python_3: Python ----------
print inputTree

idx_list = []

for i in range(inputTree.BranchCount):
    inputThisBranch = inputTree.Branch(i)
    pathLength = inputTree.Path(i).Length
    pathFirstNumber = inputTree.Path(i)[0]
    idx_list.append(pathFirstNumber)
# ---------- end python_3 ----------
item_2 = ListItem(List=python_3.idx_list, Index=Slider(44, range=0..100), Wrap=True)
item_3 = ListItem(List=pt_4, Index=python_3.idx_list, Wrap=True)
item_4 = ListItem(List=pt_4, Index=item_2, Wrap=True)
branch = TreeBranch(Tree=clean, Path=item_2, MaintainPaths=True)
preview_2 = CustomPreview(Geometry=item_3, Material=ColourSwatch(SwatchColor=RGB(255, 242, 0)))  # disabled
preview_3 = CustomPreview(Geometry=branch, Material=ColourSwatch(SwatchColor=RGB(27, 242, 37)))  # disabled
preview_4 = CustomPreview(Geometry=item_4, Material=ColourSwatch(SwatchColor=RGB(0, 115, 255)))  # disabled

panel = Panel(clean)
